# Dynamo custom node '-Copy'_Suffix.dyf (Dynamo 2.13.1.3887)
# category: AshleyBIM
# Adds a '-copy' suffix to a name/number if the name/number already exists in a given list.

New = Input(New: string)
Existing = Input(Existing: string)
python_script = Python(IN[0]=New, IN[1]=Existing)  # CPython3
# ---------- python_script.python (11 lines) ----------
nnum = IN[0] 
enum = IN[1]

for i in range(len(nnum)):
    if nnum[i] in enum:
        new_name = nnum[i] + '_copy'
        while new_name in enum or new_name in nnum:
            new_name += '_copy'
        nnum[i] = new_name

OUT = nnum
# ----------------------------------------
Renamed = Output(python_script)
